# Grasshopper definition ach1.gh (Grasshopper 0.9.76)

panel = Panel("C:\Users\EmN\Google Drive\520_SCRIPTS_PROCESSING\map_0_7_1_WithGraphWorking\data\ach1.osm")
loc = Location(FilePText=panel)  # -> OSMPointData, OSMData, LongitudeDomain, LatitudeDomain
genosm = GenericOSM(OSMPointData=loc.OSMPointData, OSMDataText=loc.OSMData, FeatureKey="building", FeatureValue="*", CollectionType=0)  # -> FeaturePoints, FeatureKey
minrds = MinorRoads(OSMPointData=loc.OSMPointData, OSMDataText=loc.OSMData, CollectionType=0)  # -> Residential, UnclassifiedRoads, NotClassified, FeatureKey
pline = PolyLine(Vertices=genosm.FeaturePoints, Closed=True)
panel_2 = Panel(loc.LongitudeDomain)
rail = Railways(OSMPointData=loc.OSMPointData, OSMDataText=loc.OSMData, CollectionType=0)  # -> Rail, Tram, LightRail, Subway, MonoRail, NarrowGauge, FeatureKey
water = WaterWays(OSMPointData=loc.OSMPointData, OSMDataText=loc.OSMData, CollectionType=0)  # -> Coastlines, Lakes, Rivers, Riverbanks, Streams, Canals, ManMade, Dams, FeatureKey
